# Grasshopper definition ghPython_001.gh (Grasshopper 1.0.7)

# Explaining Recursion
# In recursion, you call a Python function,
# it does something,
# and then it calls itself repeatedly until it reaches a specific condition-
# but all those previous calls are still active.
# The calls unwind themselves one at a time until the first call finally ends with the correct answer,
# and this unwinding process is where most people encounter a problem.
# The conditions for ending recursion haven't been met,
# so the function must call itself again.
# The conditions for ending recursion have been met,
# so the function returns a final value that is used to calculate the ending result.
number_slider = Slider(4, range=0..10)
# It's important to realize that there isn't just one methon for using recursion to solve a problem.
# Here's another version of the factorial recursion that uses fewer lines of code.
number_slider_2 = Slider(4, range=0..10)
factorial = Factorial(Number=number_slider)
ghpython_script = GhPythonScript(n=number_slider)  # -> out, a; inputs n: Int32
# ---------- ghpython_script: Python ----------
__author__ = "Sculpture"
__version__ = "2022.06.02"

import rhinoscriptsyntax as rs

def factorial(n):
    print('factorial called with n = ' + str(n))
    if n == 1 or n == 0:
        print('Ending condition met. ')
        return 1
    else:
        return n * factorial(n-1)
        
print(factorial(n))

a = factorial(n)
# ---------- end ghpython_script ----------
ghpython_script_2 = GhPythonScript(n=number_slider_2)  # -> out, a; inputs n: Int32; unedited script template
panel = Panel(factorial)
panel_2 = Panel(ghpython_script.out)
panel_3 = Panel(ghpython_script_2.out)
