# Grasshopper definition ghPython_009.gh (Grasshopper 1.0.7)

# ALGORITHMS for Dummies TRANSLATED IN TO GRASSHOPPER FOR RHINO3D, Chapter 5: Developing a Matrix Computation Class
# NumPy ranks in the top ten Python libraries.
# 
# There are reasons not to use numpy and to create your own class to perform at least the basic matrix manipulation tasks.
# 
# This will help you understand what's involved in creating such a class.
# 
# You may need to know how to flatten your matrix for certain types of calculations.
# 
# Source code is available online, however it will need to be fit to the grasshopper ghpython component to work in Rhino3D.
# Avoiding the Use of NumPy
# 
# Updates may charge your application to fail.
# 
# Coplexity at 486 page user guide.
# 
# Changes are difficult to make.
# 
# NumPOy requires C/C++ in addition to Python.
# rely on C++ arrays, rather than Pythons doubly linked lists.
# 
# Difficult
# 
# NumPy uses values that Python doesn't understand.  i.e. NAN
# 
# Using a contiguous range of memory slows things down.
# Understanding Why Using a Class is Important
# 
# Object-Oriented Programming (OOP)
# 1. Encapsulation
# 2. Inheritance
# 3. Polymorphism
# 
# Here are the reasons to use a class to hold your matrix routines:
# 1. Organization
# 2. Ease to access
# 3. Esier development
# 4. Collision elimination
# 5. Cohesiveless
# Building the Basic Class
number_slider = Slider(100, range=0..100)
number_slider_2 = Slider(5, range=0..10)
ghpython_script = GhPythonScript(count=number_slider, num=Slider(49, range=0..100))  # -> out, count, num; inputs count: Int32, num: Int32
# ---------- ghpython_script: Python ----------
__author__ = "Sculpture"
__version__ = "2022.06.04"

import rhinoscriptsyntax as rs


def search(searchList, key):
    mid = int(len(searchList)/2)
    print("Searching midpoint at " + str(searchList[mid]))
    
    
    if mid == 0:
        print("Key Not Found!")
        return key
    
    elif key == searchList[mid]:
        print("Key Found!")
        return searchList[mid]
        
    elif key >= searchList[mid]:
        print("searchList now contains "+ str(searchList[mid:len(searchList)]))
        search(searchList[mid:len(searchList)], key)
        
    else:
        print("searchList now contains "+ str(searchList[0:mid]))
        search(searchList[0:mid], key)

aList = list(range(1, count))
search(aList, num)
# ---------- end ghpython_script ----------
panel = Panel(ghpython_script.out)
panel_2 = Panel(ghpython_script.count)
panel_3 = Panel(ghpython_script.num)
