# Grasshopper definition ghPython_Algorithms4Dummies_Chapter_5_6.gh (Grasshopper 1.0.7)
# Copyright: © 2017-2018 Pierre Cuvilliers, Caitlin Mueller, Massachusetts Institute of Technology

# ALGORITHMS for Dummies TRANSLATED IN TO GRASSHOPPER FOR RHINO3D, Chapter 6: Structuring Data
# Raw data is just that: raw.
# Needs to be structures and cleaned.
# Stacks, queues and dictionaries
# Trees and Graphs
# Determining the Need for Structure
# All data need the same attributes, appearance and components.
# This relies on have the data in sorted order.
# 
# Making it easier to see the content
# Need to understand the content of the data
# i.e. "1" the string and 1 the integer differ to the computer
# i.e. (913) 912 1234 vs. 013-912-1234 differs as well
# 
# Matching data from various sources
# 1. determine both datasets contain all the required data
# 2. check both datasets for data type issues
# 3. ensure all datasets place the same meaning in data elements
# 4. verify data attributes
# 
# Consider the need for remediation
# time consuming and straightforward
# data duplication and missing data:
# 
# Dealing with data duplication:
# import pandas as pd
matrix_class = GhPythonScript()  # -> out
# ---------- matrix_class: Python ----------
__author__ = "Sculpture"
__version__ = "2022.06.04"

import rhinoscriptsyntax as rs
import scriptcontext as sc
import ghpythonremote
# Grasshopper does not recognize remote list objects as list:
from ghpythonlib.treehelpers import list_to_tree #rhino 6,7 only!
numpy = sc.sticky['numpy']
rpy = sc.sticky['rpy']
scipy = sc.sticky['scipy']
matplotlib = sc.sticky['matplotlib']
matplotlib.pyplot = sc.sticky['matplotlib.pyplot']
numpy.linalg = sc.sticky['numpy.linalg']
pandas = sc.sticky['pandas']

#algorithm


#Outputs
# ---------- end matrix_class ----------
# conda install matplotlib -n rhinoremote
# conda install pandas -n rhinoremote
panel = Panel("""numpy
scipy
numpy.linalg
matplotlib
matplotlib.pyplot
pandas
Queue""")
matrix_class_2 = GhPythonScript()  # -> out
# ---------- matrix_class_2: Python ----------
__author__ = "Sculpture"
__version__ = "2022.06.04"

import rhinoscriptsyntax as rs
import scriptcontext as sc
import ghpythonremote
# Grasshopper does not recognize remote list objects as list:
from ghpythonlib.treehelpers import list_to_tree #rhino 6,7 only!
numpy = sc.sticky['numpy']
pandas = sc.sticky['pandas']
rpy = sc.sticky['rpy']
scipy = sc.sticky['scipy']
matplotlib = sc.sticky['matplotlib']
matplotlib.pyplot = sc.sticky['matplotlib.pyplot']
numpy.linalg = sc.sticky['numpy.linalg']

#algorithms
df = pandas.DataFrame({'A' : [0,0,0,0,0,1,0],'B' : [0,2,3,5,0,2,0], 'C' : [0,3,4,1,0,2,0]})

#Outputs
print(df)

df = df.drop_duplicates()
print(df)
print type(df)
#how to turn a DataFrame back into a tree for gh?
#One Example: https://stackoverflow.com/questions/15110889/convert-list-of-arrays-in-python-to-tree-in-grasshopper
# ---------- end matrix_class_2 ----------
# Understanding other remediation issues
# 
# i.e. users misspell
matrix_class_3 = GhPythonScript()  # -> out
# ---------- matrix_class_3: Python ----------
__author__ = "Sculpture"
__version__ = "2022.06.04"

import rhinoscriptsyntax as rs
import scriptcontext as sc
import ghpythonremote
# Grasshopper does not recognize remote list objects as list:
from ghpythonlib.treehelpers import list_to_tree #rhino 6,7 only!

numpy = sc.sticky['numpy']
pandas = sc.sticky['pandas']
rpy = sc.sticky['rpy']
scipy = sc.sticky['scipy']
matplotlib = sc.sticky['matplotlib']
matplotlib.pyplot = sc.sticky['matplotlib.pyplot']
numpy.linalg = sc.sticky['numpy.linalg']


#algorithm
df = pandas.DataFrame({'A' : [0,0,1,None],'B' : [1,2,3,4], 'C' : [numpy.NAN,3,4,1]})

#Outputs
print(df)

values = pandas.Series(df.mean())
print(values)
#can't set datatype to int in ghpython
#limitations of using grasshopper, hitting a wall with different classes, (Matrix and DataFrames, Series)
print type(values)

df = df.fillna(values)
print(df)
#how to turn a DataFrame back into a tree for gh?
#One Example: https://stackoverflow.com/questions/15110889/convert-list-of-arrays-in-python-to-tree-in-grasshopper
# ---------- end matrix_class_3 ----------
panel_2 = Panel(matrix_class_2)
# Dealing with missing values
# 
# you can set them to a standard value, "0"
panel_3 = Panel(matrix_class_3)
gh_python_remote = GHPythonRemote(location="C:\Users\Sculpture\anaconda3\envs\rhinoremote", run=Toggle(True), modules=panel)  # -> out, linked_modules, rpy, import_statements
ghpython_script = GhPythonScript()  # -> Out, A
panel_4 = Panel(gh_python_remote.import_statements)
panel_5 = Panel(gh_python_remote.out)
# Using queues
# 
# first in/first out (FIFO)
# import queue
matrix_class_4 = GhPythonScript()  # -> out
# ---------- matrix_class_4: Python ----------
__author__ = "Sculpture"
__version__ = "2022.06.04"

import rhinoscriptsyntax as rs
import scriptcontext as sc
import ghpythonremote
# Grasshopper does not recognize remote list objects as list:
from ghpythonlib.treehelpers import list_to_tree #rhino 6,7 only!

numpy = sc.sticky['numpy']
pandas = sc.sticky['pandas']
rpy = sc.sticky['rpy']
scipy = sc.sticky['scipy']
matplotlib = sc.sticky['matplotlib']
matplotlib.pyplot = sc.sticky['matplotlib.pyplot']
numpy.linalg = sc.sticky['numpy.linalg']


#algorithm
MyStack = []
StackSize = 3

def DisplayStack():
    print("Stack currently contains:")
    for Item in MyStack:
        print(Item)


def Push(Value):
    if len(MyStack) < StackSize:
        MyStack.append(Value)
    else:
        print("Stack is full!")


def Pop():
    if len(MyStack) > 0:
        print("Popping: ", MyStack.pop())
    else:
        print("Stack is empty.")


#Outputs
#Test the stack functionality.
Push(1)
Push(2)
Push(3)
DisplayStack()

Push(4)

Pop()
DisplayStack()

Pop()
Pop()
Pop()
# ---------- end matrix_class_4 ----------
matrix_class_5 = GhPythonScript()  # -> out
# ---------- matrix_class_5: Python ----------
__author__ = "Sculpture"
__version__ = "2022.06.04"

import rhinoscriptsyntax as rs
import scriptcontext as sc
import ghpythonremote
# Grasshopper does not recognize remote list objects as list:
from ghpythonlib.treehelpers import list_to_tree #rhino 6,7 only!

numpy = sc.sticky['numpy']
pandas = sc.sticky['pandas']
rpy = sc.sticky['rpy']
scipy = sc.sticky['scipy']
matplotlib = sc.sticky['matplotlib']
matplotlib.pyplot = sc.sticky['matplotlib.pyplot']
numpy.linalg = sc.sticky['numpy.linalg']
Queue = sc.sticky['Queue']

#algorithm
MyQueue = Queue.Queue(3)

#Outputs
print"Queue empty: ", MyQueue.empty()
print type(MyQueue)

MyQueue.put(1)
MyQueue.put(2)
MyQueue.put(3)
print"Queue full: ", MyQueue.full()

print"Popping: ", MyQueue.get()
print"Queue full: ", MyQueue.full()

print"Popping: ", MyQueue.get()
print"Popping: ", MyQueue.get()
print"Queue empty : ", MyQueue.empty()

#Queue requires a lot less code than Stack
# ---------- end matrix_class_5 ----------
# Stacking and Piling Data in Order
# 
# Ordering in stacks
# Last in/first out (LIFO)
# i.e. Implementing with Python List to see how it works
panel_6 = Panel(matrix_class_4)
panel_7 = Panel(matrix_class_5)
# Finding data using dictionaries
matrix_class_6 = GhPythonScript()  # -> out; same code as matrix_class_5
panel_8 = Panel(matrix_class_6)

# ==== cluster GHPythonRemote: Connects the Grasshopper Python component to an external Python instance.
python = PythonScript()  # -> gh_parent_doc_dir
# ---------- python: Python ----------
from os import path

gh_parent_doc_dir = path.abspath(path.dirname(ghenv.Component.OnPingDocument().Owner.OnPingDocument().FilePath))
# ---------- end python ----------
# GH to python remote example.
# Pierre Cuvilliers, 2017-2018
# Released under the MIT license
# github.com/pilcru/ghpythonremote
# Runs and connects to an external python engine, and
# assigns imported modules to scriptcontext.sticky variables.
# 
# Arguments:
#       code (str): Path to the GH_to_python_sticky.py code file.
#       location (str): Path to a python executable, or to a folder
#             containing `python.exe`, or the name of a conda-created
#             virtual environment prefixed by `conda://` (`conda://env_name`).
#             If empty, finds python from your windows %PATH%.
#       run (boolean): Creates the connection, and imports new
#             modules, when turned to True. Kills the connection,
#             and deletes the references to the imports, when turned
#             to False.
#       modules (str list): List of module names to import in the
#             remote python. They will be added to the
#             scriptcontext.sticky dictionary, allowing them to be
#             reused from other python components in the same
#             Grasshopper document. Submodules (for example
#             `numpy.linalg` have to be added explicitly to this list
#             to be available later.
#       log_level (str from ['NOTSET', 'DEBUG', 'INFO', 'WARNING', 'ERROR', 'CRITICAL']):
#             Logging level to use for the local IronPython and the
#             remote python instance.
#       working_dir (str): Working directory for the remote python
#             instance.
# 
# Returns:
#       out (str): Console output with DEBUG information.
#       linked_modules (str list): list of imported module names.
#       rpy (rpyc connection object): The object representing the
#             remote Python interpreter.
location = ClusterInput()  # location (str): Path to a python executable, or to a folder containing `python.exe`, or the name of a conda-created virtual environment prefixed by `conda://` (`conda://env_name`). If empty, finds python from your windows %PATH%.
run = ClusterInput()  # run (boolean): Creates the connection, and imports new modules, when turned to True. Kills the connection,and deletes the references to the imports, when turned to False.
modules = ClusterInput()  # modules (str list): List of module names to import in the remote python. They will be added to the scriptcontext.sticky dictionary, allowing them to be reused from other python components in the same Grasshopper document. Submodules (for example `numpy.linalg` have to be added explicitly to this list to be available later.
list = ValueList({"CRITICAL", "ERROR", "WARNING", "INFO", "DEBUG", "NOTSET"}, selected="DEBUG")
panel = Panel(python)
ghpythonremote = GHPythonRemote(location=location, run=run, modules=modules, log_level=list, working_dir=panel)  # -> out, linked_modules, rpy; inputs run: Boolean, modules: list
# ---------- ghpythonremote: Python ----------
import inspect
import logging
from os import path
import sys
from time import sleep

import scriptcontext

import ghpythonremote
from ghpythonremote.connectors import GrasshopperToPythonRemote

local_log_level = getattr(logging, log_level, logging.WARNING)
logger = logging.getLogger("ghpythonremote")
logger.setLevel(local_log_level)
ch = logging.StreamHandler()
ch.setLevel(local_log_level)
formatter = logging.Formatter("%(levelname)s: %(name)s:\n%(message)s")
ch.setFormatter(formatter)
logger.handlers = []
logger.addHandler(ch)
logger = logging.getLogger("ghpythonremote.GH_to_python")

ROOT = path.abspath(path.dirname(inspect.getfile(ghpythonremote)))
rpyc_server_py = path.join(ROOT, "pythonservice.py")

# Set connection to CLOSED if this is the first run
# and initialize set of linked modules
try:
    remote_python_status
except NameError:
    remote_python_status = "CLOSED"
    lkd_modules = set()

# Wait for connection to connect or terminate
timer = 0
while remote_python_status == "CONNECTING" or remote_python_status == "CLOSING":
    sleep(1)
    timer += 1
    if timer == 10:
        try:
            gh2py_manager.__exit__(*sys.exc_info())
        except Exception:
            pass
        remote_python_status = "CLOSED"
        lkd_modules = set()
        raise RuntimeError(
            "Connection left in an inconsistent state and not returning. Reset "
            "everything."
        )

if run:
    if not remote_python_status == "OPEN":
        remote_python_status = "CONNECTING"
        gh2py_manager = GrasshopperToPythonRemote(
            rpyc_server_py,
            location=location,
            timeout=10,
            port=None,
            log_level=log_level,
            working_dir=working_dir,
        )
        gh2py = gh2py_manager.__enter__()
        remote_python_status = "OPEN"

    # Stuff that we can reach
    rpymod = gh2py.py_remote_modules  # A getter function for a named python module
    rpy = gh2py.connection  # Represents the remote instance root object
    scriptcontext.sticky["rpy"] = rpy
    # Add modules
    for mod in modules:
        try:
            scriptcontext.sticky[mod] = rpymod(mod)
            lkd_modules.add(mod)
        except ImportError:
            gh2py_manager.__exit__(*sys.exc_info())
            raise

elif not remote_python_status == "CLOSED":
    remote_python_status = "CLOSING"
    # Remove linked modules
    for mod in lkd_modules:
        del scriptcontext.sticky[mod]
    del scriptcontext.sticky["rpy"]
    gh2py_manager.__exit__(*sys.exc_info())
    lkd_modules = set()
    remote_python_status = "CLOSED"

# Change variable name because ghpython resets outputs to None before each run
linked_modules = lkd_modules

logger.info("GH to python connection is {}".format(remote_python_status))
# ---------- end ghpythonremote ----------
out = ClusterOutput(ghpythonremote.out)  # Console output.
linked_modules = ClusterOutput(ghpythonremote.linked_modules)  # Names of modules that were successfully added to the scriptcontext.sticky dictionary.
rpy = ClusterOutput(ghpythonremote.rpy)  # The object representing the remote python instance
python_2 = PythonScript(module_names=ghpythonremote.linked_modules)  # -> import_statements; inputs module_names: list
# ---------- python_2: Python ----------
import_statements = ["import scriptcontext as sc"]
for module_name in module_names:
    import_statements.append("{0} = sc.sticky['{0}']".format(module_name))

if len(module_names) == 0:
    import_statements = []
# ---------- end python_2 ----------
import_statements = ClusterOutput(python_2)  # Useful import statements to use the imported modules in your scripts.
